% Simulink data dictionary MY_SMD_DATA_DICT.sldd
% references MY_SMD_ICs.sldd

c = 5
k = 25
m = 1
CF_01 = Simulink.ConfigSet(StartTime="0", StopTime="10", RelTol="1e-7", Solver="ode45", ProdHWDeviceType="Intel->x86-64 (Windows64)", SystemTargetFile="grt.tlc", TargetLang="C")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